# Grasshopper definition demo.gh (Grasshopper 1.0.8)
# plug-ins: SandMartin.Host

probability = Slider(1, range=0..1)
random_3d_boxes_grid = CSharpScript(y=probability)  # -> out, a; inputs x: Int32, y: Double
# ---------- random_3d_boxes_grid: C# ----------
using System;
using System.Collections.Generic;
using Rhino.Geometry;

public class Script_Instance : GH_ScriptInstance
{
  private void RunScript(int x, double y, ref object a)
  {
    // x is ignored, using 5x5x5
    // y is used as probability
    var boxes = new List<Box>();
    var rnd = new Random(42);
    
    double threshold = y;

    for (int i = 0; i < 5; i++) {
      for (int j = 0; j < 5; j++) {
        for (int k = 0; k < 5; k++) {
          
          if (rnd.NextDouble() > threshold) continue;

          var center = new Point3d(i * 10, j * 10, k * 10);
          var size = 2.0 + rnd.NextDouble() * 5.0;
          var box = new Box(Plane.WorldXY, 
            new Interval(center.X - size/2, center.X + size/2), 
            new Interval(center.Y - size/2, center.Y + size/2), 
            new Interval(center.Z - size/2, center.Z + size/2));
          boxes.Add(box);
        }
      }
    }
    a = boxes;
  }
}
# ---------- end random_3d_boxes_grid ----------
sandmartin = SandMartinServer(Run=Toggle(False), AllowCodeInjection=True)
